# Grasshopper definition GrasshopperScript.gh (Grasshopper 1.0.7)
# plug-ins: MeshEdit Components, Human, Kangaroo Components, Kangaroo2 Components

# ----
# Model 0
number_slider = Slider(-20, range=-20..20)
pointload = Point([Point(0, 0, 10), Point(5, 0, 10), Point(0, 5, 5), Point(0, 5, 10), Point(0, 0, 5)])
vec = VectorXYZ(XComponent=0, YComponent=number_slider, ZComponent=0)  # -> Vector, Length
support = Point([Point(0, 0, 0), Point(5, 0, 0), Point(10, 0, 0), Point(15, 0, 0), Point(15, 5, 0), Point(10, 5, 0), Point(5, 5, 0), Point(0, 5, 0)])
shell = Mesh([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])
beam = Curve([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])
truss = Curve([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])
vec_2 = VectorXYZ(XComponent=Slider(13, range=-20..20), YComponent=0, ZComponent=0)  # -> Vector, Length
vec_3 = VectorXYZ(XComponent=0, YComponent=Slider(11, range=-20..20), ZComponent=0)  # -> Vector, Length
cantiliver = Curve([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])
columns = Curve([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])
refine = Refine(Mesh=shell, Level="2")
mesh = Mesh(refine)
clean = CombineClean(Meshes=mesh)
explode = MeshExplode(Mesh=clean, Interpolate=False)  # -> flatten(Faces)
entwine = Entwine(
    Branch00=explode,
    Branch01=beam,
    Branch02=truss,
    Branch03=support,
    Branch04=pointload,
    Branch05=vec.Vector,
    Branch06=columns,
    Branch07=vec_2.Vector,
    Branch08=cantiliver,
    Branch09=vec_3.Vector,
    FlattenInputs=True)

# ----
# Model 2
number_slider_2 = Slider(10, range=0..10)
vector_xyz = VectorXYZ(XComponent=0, YComponent=0, ZComponent=0)  # -> Vector, Length
vector_xyz_2 = VectorXYZ(XComponent=0, YComponent=0, ZComponent=number_slider_2)  # -> Vector, Length
vec_4 = VectorXYZ(XComponent=Slider(13, range=-20..20), YComponent=0, ZComponent=0)  # -> Vector, Length
move = Move(Geometry=vector_xyz.Vector, Motion=vector_xyz_2.Vector)  # -> Geometry, Transform
line = Line(StartPoint=vector_xyz.Vector, EndPoint=move.Geometry)
vec_5 = VectorXYZ(XComponent=0, YComponent=Slider(-20, range=-20..20), ZComponent=0)  # -> Vector, Length
pointload_2 = Point(move.Geometry)
support_2 = Point(vector_xyz.Vector)
beam_2 = Curve(line)
columns_2 = Curve(beam_2)
entwine_2 = Entwine(
    Branch01=beam_2,
    Branch03=support_2,
    Branch04=pointload_2,
    Branch05=vec_5.Vector,
    Branch06=columns_2,
    Branch07=vec_4.Vector,
    FlattenInputs=True)

# ---- group: Element
data = Data(0)
data_2 = Data(0)

# ---- group: Load
data_3 = Data(0)
data_4 = Data(0)

# ---- group: Cross-Section
data_5 = Data(0)
data_6 = Data(0)

# ---- group: Support
data_7 = Data(0)
data_8 = Data(0)

# ---- group: Material
data_9 = Data(0)
data_10 = Data(0)

# ---- group: Constraint
data_11 = Data(0)
data_12 = Data(0)

# ----
# Model 1
panel = Panel("2")
shell_2 = Mesh([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])
refine_2 = Refine(Mesh=shell_2, Level=panel)
mesh_2 = Mesh(refine_2)
clean_2 = CombineClean(Meshes=mesh_2)
deconstruct_mesh = DeconstructMesh(Mesh=clean_2)  # -> Vertices, Faces, Colours, Normals
removeduplicatepts = RemoveDuplicatePts(Points=flatten(deconstruct_mesh.Vertices), Tolerance=0.01)
pdecon = Deconstruct(Point=removeduplicatepts)  # -> XComponent, YComponent, ZComponent
explode_2 = MeshExplode(Mesh=clean_2, Interpolate=False)  # -> flatten(Faces)
larger_than = LargerThan(FirstNumber=pdecon.ZComponent, SecondNumber="10")  # -> LargerThan, OrEqualTo
smaller_than = SmallerThan(FirstNumber=pdecon.ZComponent, SecondNumber=Slider(0.1, range=0..0.1))  # -> SmallerThan, OrEqualTo
cull_pattern = CullPattern(List=removeduplicatepts, CullPattern=smaller_than.OrEqualTo)
cull_pattern_2 = CullPattern(List=removeduplicatepts, CullPattern=larger_than.OrEqualTo)
vec_6 = VectorXYZ(XComponent=Slider(17, range=-20..20), YComponent=Slider(0, range=-20..20), ZComponent=Slider(-100, range=-100..20))  # -> Vector, Length
pointload_3 = Point(cull_pattern_2)
support_3 = Point(cull_pattern)
entwine_3 = Entwine(Branch00=explode_2, Branch03=support_3, Branch04=pointload_3, Branch05=vec_6.Vector, FlattenInputs=True)

list = ValueList({"Building": 0, "Shell": 1, "Cantiliver": 2}, selected="Shell")
custom_preview = CustomPreview(Geometry=support, Material=ColourSwatch(SwatchColor=RGB(0, 0, 0)))
stream_filter = StreamFilter(Gate=list, Stream0=entwine, Stream1=entwine_3, Stream2=entwine_2)
explode_tree = ExplodeTree(Data=stream_filter)  # -> Branch0, Branch1, Branch2, Branch3, Branch4, Branch5, Branch6, Branch7, Branch8, Branch9

pointload_4 = Point(explode_tree.Branch4)
vector = Data(explode_tree.Branch5)

support_4 = Point(explode_tree.Branch3)
shell_3 = Mesh(explode_tree.Branch0)
beam_3 = Curve(explode_tree.Branch1)
truss_2 = Curve(explode_tree.Branch2)

data_13 = Data(explode_tree.Branch6)
vector_2 = Data(explode_tree.Branch7)

data_14 = Data(explode_tree.Branch8)
vector_3 = Data(explode_tree.Branch9)

# ----
# UniaxialMaterial
# Elastic
file_path = FilePath("C:\GitHub\Alpaca4d\PythonScript\Pre-Processing\Material\uniAxialMaterial\ElasticUniaxialMaterial.py")
read_file = ReadFile(File=file_path, PerLineParse=False)
python = GhPythonScript(Code=read_file, MatName="S275", E="210000", G="80760", Rho="75", Fy="35")  # -> Out, ElasticMaterialWrapper
python_2 = GhPythonScript(x=python.ElasticMaterialWrapper)  # -> out, a
# ---------- python_2: Python ----------
a = x
# ---------- end python_2 ----------
panel_2 = Panel(python_2.a)

# ----
# UniaxialMaterial
# Elastic
panel_3 = Panel("210000")
python_3 = GhPythonScript(Code=read_file, MatName="S255", E=panel_3, G="80760", Rho="75", Fy="25")  # -> Out, ElasticMaterialWrapper
python_4 = GhPythonScript(x=python_3.ElasticMaterialWrapper)  # -> out, a; same code as python_2
panel_4 = Panel(python_4.a)

# ----
# nDMaterial
# ElasticIsotropic
file_path_2 = FilePath("C:\GitHub\Alpaca4d\PythonScript\Pre-Processing\Material\nDMaterial\ElasticIsotropic.py")
read_file_2 = ReadFile(File=file_path_2, PerLineParse=False)
python_5 = GhPythonScript(Code=read_file_2, MatName="S275", E="210000", G="80760", Rho="75", Fy="35")  # -> Out, ElasticMaterialWrapper

# ----
# Support
file_path_3 = FilePath("C:\GitHub\Alpaca4d\PythonScript\Pre-Processing\Element\Support\Support.py")
toggle = BooleanToggle(True)
read_file_3 = ReadFile(File=file_path_3, PerLineParse=False)
point = Point(support_4)
python_6 = GhPythonScript(Code=read_file_3, Pos=graft(point), Tx=toggle, Ty=Toggle(True), Tz=toggle, Rx=toggle, Ry=toggle, Rz=toggle)  # -> Out, flatten(SupportWrapper)
python_7 = GhPythonScript(x=python_6.SupportWrapper)  # -> out, a; same code as python_2
panel_5 = Panel(python_7.a)

# ----
# Circular CrossSection
file_path_4 = FilePath("C:\GitHub\Alpaca4d\PythonScript\Pre-Processing\Section\CircularCrossSection.py")
read_file_4 = ReadFile(File=file_path_4, PerLineParse=False)
python_8 = GhPythonScript(Code=read_file_4, SectionName="CHS", Diameter="50", Thickness="25", Material=python_3.ElasticMaterialWrapper)  # -> Out, CircleCrossSection

# ----
# Elastic Membrane Plate Section
file_path_5 = FilePath("C:\GitHub\Alpaca4d\PythonScript\Pre-Processing\Section\ElasticMembranePlateSection.py")
read_file_5 = ReadFile(File=file_path_5, PerLineParse=False)
python_9 = GhPythonScript(Code=read_file_5, SectionName="concreteSlab", Thickness="200", Material=python_5.ElasticMaterialWrapper)  # -> Out, PlateFiberSection

# ----
# Generic Cross Section
file_path_6 = FilePath("C:\GitHub\Alpaca4d\PythonScript\Pre-Processing\Section\GenericCrossSection.py")
read_file_6 = ReadFile(File=file_path_6, PerLineParse=False)
python_10 = GhPythonScript(
    Code=read_file_6,
    SectionName="Generic",
    Area="20",
    Ay="20",
    Az="20",
    Iyy="20",
    Izz="20",
    J="20",
    Material=python.ElasticMaterialWrapper)  # -> Out, GenericCrossSection

# ----
# Rectangular Cross Section
file_path_7 = FilePath("C:\GitHub\Alpaca4d\PythonScript\Pre-Processing\Section\RectangularCrossSection.py")
read_file_7 = ReadFile(File=file_path_7, PerLineParse=False)
python_11 = GhPythonScript(Code=read_file_7, SectionName="RHS", Base="175", Height="175", Material=python.ElasticMaterialWrapper)  # -> Out, RectangularCrossSection

# ----
# Point Load
file_path_8 = FilePath("C:\GitHub\Alpaca4d\PythonScript\Pre-Processing\Load\PointLoad.py")
read_file_8 = ReadFile(File=file_path_8, PerLineParse=False)
vector_4 = Vector(expr("x*0", Vector(2.518385542, -6.656153768, 0)))
vector_5 = Vector(vector)
point_2 = Point(pointload_4)
python_12 = GhPythonScript(Code=read_file_8, Force=vector_5, Moment=vector_4, Pos=point_2)  # -> Out, flatten(LoadWrapper)

random = Random(Range="20", Number="100", Seed=2)
random_2 = Random(Range="20", Number="100", Seed="3")
pt = ConstructPoint(XCoordinate=random, YCoordinate=random_2, ZCoordinate=0)
python_13 = GhPythonScript(Pos=pt, RigidDiaphragm=Toggle(True))  # -> Out, A

file_path_9 = FilePath("C:\GitHub\Alpaca4d\PythonScript\Pre-Processing\Load\BeamLoad.py")

pt_2 = ConstructPoint(XCoordinate=0, YCoordinate=0, ZCoordinate=0)
# WIP
panel_6 = Panel("25")

read_file_9 = ReadFile(File=file_path_9, PerLineParse=False)

# ----
# Linear Load
value_list = ValueList({"LocalAxis": 0, "GlobalAxis": 1}, selected="GlobalAxis")
crv = Curve(data_13)
vector_6 = Vector(vector_2)
python_14 = GhPythonScript(Code=read_file_9, Force=vector_6, Element=crv, Orientation=value_list)  # -> Out, flatten(BeamUniformLoad)

# ----
# Linear Load
value_list_2 = ValueList({"LocalAxis": 0, "GlobalAxis": 1}, selected="GlobalAxis")
crv_2 = Curve(data_14)
vector_7 = Vector(vector_3)
python_15 = GhPythonScript(Code=read_file_9, Force=vector_7, Element=crv_2, Orientation=value_list_2)  # -> Out, flatten(BeamUniformLoad)

# ----
# ****MassLoad****
python_16 = GhPythonScript(NodalMassTranslation=panel_6, Pos=pt_2)  # -> out, flatten(Mass); inputs Pos: Point3d
# ---------- python_16: Python ----------
import Rhino.Geometry as rg

def pointLoad(Pos, NodalMassTranslation):

    NodalMassTranslation = rg.Point3d(NodalMassTranslation, NodalMassTranslation, NodalMassTranslation)
    

    return [[Pos, NodalMassTranslation]]

Mass = pointLoad(Pos, NodalMassTranslation)
# ---------- end python_16 ----------

# ----
# LineToBeam
file_path_10 = FilePath("C:\GitHub\Alpaca4d\PythonScript\Pre-Processing\Element\LineToBeam\LineToBeam.py")
read_file_10 = ReadFile(File=file_path_10, PerLineParse=False)
list_2 = ValueList({"Truss": 0, "Beam": 1}, selected="Beam")
crv_3 = Curve(beam_3)
python_17 = GhPythonScript(
    Code=read_file_10,
    Line=crv_3,
    Colour=ColourSwatch(SwatchColor=RGB(34, 255, 0)),
    CrossSection=python_11.RectangularCrossSection,
    OrientSection="0",
    BeamType=list_2)  # -> Out, flatten(BeamWrapper)

# ----
# meshToShell
file_path_11 = FilePath("C:\GitHub\Alpaca4d\PythonScript\Pre-Processing\Element\MeshToShell\MeshToShell.py")
read_file_11 = ReadFile(File=file_path_11, PerLineParse=False)
mesh_3 = Mesh(shell_3)
python_18 = GhPythonScript(
    Code=read_file_11,
    Mesh=mesh_3,
    Colour=ColourSwatch(SwatchColor=RGB(0, 72, 255)),
    CrossSection=python_9.PlateFiberSection)  # -> Out, flatten(ShellWrapper)

crv_4 = Curve(truss_2)

data_15 = Data([python_14.BeamUniformLoad, python_15.BeamUniformLoad, python_12.LoadWrapper])

# ----
# LineToTruss
list_3 = ValueList({"Truss": 0, "Beam": 1}, selected="Truss")
python_19 = GhPythonScript(
    Code=read_file_10,
    Line=crv_4,
    Colour=ColourSwatch(SwatchColor=RGB(255, 200, 0)),
    CrossSection=python_8.CircleCrossSection,
    OrientSection="0",
    BeamType=list_3)  # -> Out, flatten(BeamWrapper)

merge = Merge(Data1=python_18.ShellWrapper, Data2=python_17.BeamWrapper, Data3=python_19.BeamWrapper)

# ----
# Assemble
file_path_12 = FilePath("C:\GitHub\Alpaca4d\PythonScript\Pre-Processing\Assemble\Assemble.py")
read_file_12 = ReadFile(File=file_path_12, PerLineParse=False)
python_20 = GhPythonScript(Code=read_file_12, Element=flatten(merge), Support=flatten(python_6.SupportWrapper), Load=flatten(data_15))  # -> Out, OpenSeesModel

path = FilePath("C:\GitHub\Alpaca4d\PythonScript\Analyses\LinearAnalyses\initializeAnalysis.py")

# ----
# modelView
# da fare a cluster
file_path_13 = FilePath("C:\GitHub\Alpaca4d\PythonScript\Post-Processing\modelView\modelView.py")
read_file_13 = ReadFile(File=file_path_13, PerLineParse=False)
python_21 = GhPythonScript(
    Code=read_file_13,
    OpenSeesModel=python_20.OpenSeesModel,
    ModelExstrud=Toggle(False),
    Load=Toggle(False),
    Support=Toggle(False),
    LocalAxes=Toggle(False),
    NodeTag=Toggle(False),
    ElementTag=Toggle(False))  # -> ModelView, LineModel, ForceDisplay, Support, LocalAxis, TagNode, TagEle
modelview = ModelView(python_21.ModelView)
explode_tree_2 = ExplodeTree(Data=python_21.LocalAxis)  # -> Branch0, Branch1, Branch2, Branch3
explode_tree_3 = ExplodeTree(Data=python_21.LineModel)  # -> Branch0, Branch1
explode_tree_4 = ExplodeTree(Data=simplify(python_21.TagNode))  # -> Branch0, Branch1
explode_tree_5 = ExplodeTree(Data=simplify(python_21.TagEle))  # -> Branch0, Branch1
explode_tree_6 = ExplodeTree(Data=python_21.ForceDisplay)  # -> Branch0, Branch1
curve_direction = GhPythonScript(Crv=explode_tree_3.Branch0, Thickness=Slider(3, range=0..10), RGB=explode_tree_3.Branch1)  # -> out; inputs Crv: list of Curve, RGB: list of Color
# ---------- curve_direction: Python ----------
from ghpythonlib.componentbase import executingcomponent as component
import Grasshopper, GhPython
import System
import Rhino as rh
import rhinoscriptsyntax as rs
import Rhino.Geometry as rg


class CurveColor(component):

    def RunScript(self,Crv,Thickness,RGB):
        self.C = Crv
        self.RGB = RGB
        self.t = Thickness
        if not self.C: return
            
    def DrawViewportWires(self,arg):
        if not  self.C: return
        for curve, color in zip( self.C, self.RGB ):
            arg.Display.DrawCurve(curve, color,self.t)
# ---------- end curve_direction ----------
custom_preview_2 = CustomPreview(Geometry=python_21.Support, Material=ColourSwatch(SwatchColor=RGB(164, 252, 0)))
vector_display_ex = VectorDisplayEx(Point=explode_tree_6.Branch0, Vector=explode_tree_6.Branch1, Colour=ColourSwatch(SwatchColor=RGB(176, 32, 32)), Width=2)
vector_display_ex_2 = VectorDisplayEx(Point=explode_tree_2.Branch0, Vector=explode_tree_2.Branch1, Colour=ColourSwatch(SwatchColor=RGB(252, 0, 0)), Width=2)
vector_display_ex_3 = VectorDisplayEx(Point=explode_tree_2.Branch0, Vector=explode_tree_2.Branch2, Colour=ColourSwatch(SwatchColor=RGB(0, 245, 53)), Width=2)
vector_display_ex_4 = VectorDisplayEx(Point=explode_tree_2.Branch0, Vector=explode_tree_2.Branch3, Colour=ColourSwatch(SwatchColor=RGB(0, 55, 255)), Width=2)
tag = TextTag(Location=explode_tree_4.Branch0, Text=explode_tree_4.Branch1, Colour=ColourSwatch(SwatchColor=RGB(255, 0, 0)))
tag_2 = TextTag(Location=explode_tree_5.Branch0, Text=explode_tree_5.Branch1, Colour=ColourSwatch(SwatchColor=RGB(25, 0, 255)))

# ----
# solver on folder Static Analyses
file = ReadFile(File=path, PerLineParse=False)

# ----
# Modal Analyses
path_2 = FilePath("C:\GitHub\Alpaca4d\PythonScript\Analyses\DynamicAnalysis\initializeModalAnalyses.py")
file_2 = ReadFile(File=path_2, PerLineParse=False)
analyze = GhPythonScript(Code=file_2, OpenSeesModel=python_20.OpenSeesModel, NumEigenvalues="12")  # -> Out, OpenSeesOutputWrapper, Frequency, Period
panel_7 = Panel(analyze.Frequency)

# ---- group: disassemble Model
python_22 = GhPythonScript()  # -> Out, ModelView, Points, Support, Load, Material, Section

# ----
analyze_2 = GhPythonScript(Code=file, OpenSeesModel=python_20.OpenSeesModel)  # -> Out, OpenSeesOutputWrapper

# ---- group: Cds Visualisation
number_slider_3 = Slider(0.184, range=0.001..10)
file_path_14 = FilePath("C:\GitHub\Alpaca4d\PythonScript\Post-Processing\cdsView\cdsView.py")
read_file_14 = ReadFile(File=file_path_14, PerLineParse=False)
list_4 = ValueList({"N": 0, "V1": 1, "V2": 2, "M2": 3, "M1": 4, "Mt": 5}, selected="N")
python_23 = GhPythonScript(Code=read_file_14, OpenSeesOutputWrapper=analyze_2.OpenSeesOutputWrapper, Cds=list_4)

# ----
file_path_15 = FilePath("C:\GitHub\Alpaca4d\PythonScript\Post-Processing\shellForceView\shellForceView.py")

# ---- group: Beam Forces
file_path_16 = FilePath("C:\GitHub\Alpaca4d\PythonScript\Post-Processing\beamForces\beamForces.py")
read_file_15 = ReadFile(File=file_path_16, PerLineParse=False)
python_24 = GhPythonScript(Code=read_file_15, OpenSeesOutputWrapper=analyze_2.OpenSeesOutputWrapper, NumberResults=Slider(10, range=0..10))  # -> Out, TagElement, N, V1, V2, Mt, M1, M2
panel_8 = Panel(python_24.TagElement)

# ---- group: tension Visualisation
# nel shellForce avremo la mesh del diagramma che visualizziamo
# magari in questo posso mettere anche gli element brick ( se hanno le forze )
list_5 = ValueList({"sigmaX": 0, "sigmaY": 1, "sigmaZ": 2, "tauXY": 3, "tauYZ": 4, "tauXZ": 5, "mx": 6, "my": 7}, selected="sigmaX")
python_25 = GhPythonScript(ViewForce=list_5)

# ----
read_file_16 = ReadFile(File=file_path_15, PerLineParse=False)

# ---- group: Reaction Forces
file_path_17 = FilePath("C:\GitHub\Alpaca4d\PythonScript\Post-Processing\reaction\reaction.py")
read_file_17 = ReadFile(File=file_path_17, PerLineParse=False)
# Force component
python_26 = GhPythonScript(
    Code=read_file_17,
    OpenSeesOutputWrapper=analyze_2.OpenSeesOutputWrapper,
    ReactionMomentsView=Toggle(False),
    ReactionForcesView=Toggle(True))  # -> Out, TagPoints, ReactionForces, ReactionMoments, View
tagpoints = TagPoints(python_26.TagPoints)
reactionforces = ReactionForces(python_26.ReactionForces)
reactionmoments = ReactionMoments(python_26.ReactionMoments)
explode_tree_7 = ExplodeTree(Data=python_26.View)  # -> Branch0, Branch1, Branch2, Branch3
vector_display = VectorDisplay(Anchor=explode_tree_7.Branch0, Vector=[explode_tree_7.Branch1, explode_tree_7.Branch2, explode_tree_7.Branch3])

# ---- group: shell Forces
file_path_18 = FilePath("C:\GitHub\Alpaca4d\PythonScript\Post-Processing\shellForces\shellForces.py")
read_file_18 = ReadFile(File=file_path_18, PerLineParse=False)
python_27 = GhPythonScript(Code=read_file_18, OpenSeesOutputWrapper=analyze_2.OpenSeesOutputWrapper)  # -> Out, TagElement, Fx, Fy, Fz, Mx, My, Mz
panel_9 = Panel(python_27.TagElement)

# ---- group: nD Force Visualisation
list_6 = ValueList({"Fx": 0, "Fy": 1, "Fz": 2, "Mx": 3, "My": 4, "Mz": 5}, selected="My")
python_28 = GhPythonScript(Code=read_file_16, OpenSeesOutputWrapper=analyze_2.OpenSeesOutputWrapper, ViewForce=list_6)  # -> ModelForce, ShellForce

# ----
# Numerical Ouput
number_slider_4 = Slider(6, range=0..10)
file_path_19 = FilePath("C:\GitHub\Alpaca4d\PythonScript\Post-Processing\beamDisp\beamDisp.py")
file_path_20 = FilePath("C:\GitHub\Alpaca4d\PythonScript\Post-Processing\shellDisp\shellDisp.py")
file_path_21 = FilePath("C:\GitHub\Alpaca4d\PythonScript\Post-Processing\nodalDisp\nodalDisp.py")
file_path_22 = FilePath("C:\GitHub\Alpaca4d\PythonScript\Post-Processing\brickDisp\brickDisp.py")
read_file_19 = ReadFile(File=file_path_19, PerLineParse=False)
read_file_20 = ReadFile(File=file_path_20, PerLineParse=False)
read_file_21 = ReadFile(File=file_path_21, PerLineParse=False)
read_file_22 = ReadFile(File=file_path_22, PerLineParse=False)

file_path_23 = FilePath("C:\GitHub\Alpaca4d\PythonScript\Post-Processing\defModelView\defModelView.py")
read_file_23 = ReadFile(File=file_path_23, PerLineParse=False)

# ---- group: brick Displacement
python_29 = GhPythonScript(Code=read_file_22, OpenSeesOutputWrapper=analyze_2.OpenSeesOutputWrapper)  # -> Out, TagElement, Trans

# ---- group: Beam Displacement
python_30 = GhPythonScript(Code=read_file_19, OpenSeesOutputWrapper=analyze_2.OpenSeesOutputWrapper, NumberResults=number_slider_4)  # -> Out, TagElement, LocalTrans, LocalRot, GlobalTrans, GlobalRot

# ---- group: Shell Displacement
python_31 = GhPythonScript(Code=read_file_20, OpenSeesOutputWrapper=analyze_2.OpenSeesOutputWrapper)  # -> Out, TagElement, Trans, Rot

# ---- group: Displacement Nodes
python_32 = GhPythonScript(Code=read_file_21, OpenSeesOutputWrapper=analyze_2.OpenSeesOutputWrapper)  # -> Out, Points, Trans, Rot

# ----
geometry = Geometry(python_28.ModelForce)
bounds = Bounds(Numbers=flatten(python_28.ShellForce))
deconstruct_domain = DeconstructDomain(Domain=bounds)  # -> Start, End
triangulate = Triangulate(Mesh=geometry)  # -> Mesh, Count
range = Range(Domain=Domain(0, 1), Steps=Slider(9, range=0..20))
gradient = Gradient(
    LowerLimit=deconstruct_domain.End,
    UpperLimit=deconstruct_domain.Start,
    Parameter=python_28.ShellForce,
    stops=[0.101: RGB(0, 76, 255), 0.204: RGB(54, 171, 255), 0.315: RGB(0, 192, 0), 0.499: RGB(0, 255, 72), 0.624: RGB(255, 251, 0), 0.779: RGB(245, 102, 0), 0.935: RGB(220, 0, 40)])  # disabled
c_script = CSharpScript(mesh=flatten(triangulate.Mesh), values=flatten(python_28.ShellForce), iso=range)  # -> out, low_mesh, up_mesh, simplify(low_values), up_values, simplify(frontier); inputs mesh: Mesh, values: list of Double, iso: Double; disabled
# ---------- c_script: C# ----------
    //This script cut a mesh using an iso-value. Values are put on each vertex of the mesh
    //Developped by Laurent Delrieu
    //1st of September 2015

    Mesh mesh_low = new Mesh();
    Mesh mesh_up = new Mesh();
    List<double> lv = new List<Double>();
    List<double> uv = new List<Double>();
    List<Line> lines = new List<Line>();

    double min;
    double max;
    int A, B, C;

    //For each face
    for(int i = 0;i < _mesh.Faces.Count;i++)
    {
      //It is implied that Mesh has just triangles
      //Here it is looked if iso value in on face
      A = _mesh.Faces[i].A;
      B = _mesh.Faces[i].B;
      C = _mesh.Faces[i].C;
      min = Math.Min(Math.Min(_values[A], _values[B]), _values[C]);
      max = Math.Max(Math.Max(_values[A], _values[B]), _values[C]);

      //If OK there will be a triangulation
      if (isInside(_iso, min, max))
      {
        if (isInside(_iso, _values[A], _values[B]))
        {
          if (isInside(_iso, _values[A], _values[C])) remesh(_mesh, i, _values, _iso, B, A, C, ref mesh_low, ref mesh_up, ref lv, ref uv, ref lines);
          else remesh(_mesh, i, _values, _iso, A, B, C, ref mesh_low, ref mesh_up, ref lv, ref uv, ref lines);
        }
        else    remesh(_mesh, i, _values, _iso, A, C, B, ref mesh_low, ref mesh_up, ref lv, ref uv, ref lines);
      }
      else   add_face(_mesh, i, _values, _iso, A, C, B, ref mesh_low, ref mesh_up, ref lv, ref uv);
    }//End for

    mesh_low.Weld(0.001);
    mesh_low.Normals.ComputeNormals();
    mesh_low.Compact();
    mesh_up.Weld(0.001);
    mesh_up.Normals.ComputeNormals();
    mesh_up.Compact();

    low_mesh = mesh_low;
    up_mesh = mesh_up;
    low_values = lv;
    up_values = uv;

    // Rhino.Geometry.Curve.JoinCurves
    frontier = lines;
# ---------- c_script: C# additional code ----------
  public void remesh(Mesh M, int i, List<double> V, double iso, int A, int B, int C, ref Mesh mesh_low, ref Mesh mesh_up, ref List<double> lv, ref List<double> uv, ref List<Line> lines)
  {
    //M is an input mesh (triangular)
    //V are values on vertex
    //Iso is a value for splitting
    //A B C are indices for splitting segment AB and BC, so if value on B is lower than
    Point3f pAB = new Point3f();
    Point3f pBC = new Point3f();
    int npt;

    pAB = M.Vertices[A] + Vector3f.Multiply((float) ((iso - V[A]) / (V[B] - V[A])), Point3f.Subtract(M.Vertices[B], M.Vertices[A]));
    pBC = M.Vertices[B] + Vector3f.Multiply((float) ((iso - V[B]) / (V[C] - V[B])), Point3f.Subtract(M.Vertices[C], M.Vertices[B]));

    lines.Add(new Line(pAB, pBC));

    if (V[B] <= iso)
    {
      npt = mesh_low.Vertices.Count;
      mesh_low.Vertices.Add(M.Vertices[B]); //npt
      mesh_low.Vertices.Add(pAB); //npt+1
      mesh_low.Vertices.Add(pBC); //npt+2
      mesh_low.Faces.AddFace(npt, npt + 1, npt + 2);
      lv.Add(V[B]);
      lv.Add(iso);
      lv.Add(iso);

      npt = mesh_up.Vertices.Count;
      mesh_up.Vertices.Add(M.Vertices[A]); //npt
      mesh_up.Vertices.Add(pAB); //npt+1
      mesh_up.Vertices.Add(pBC); //npt+2
      mesh_up.Vertices.Add(M.Vertices[C]); //npt+3
      //Meshing of a quandrangle in the best 2 triangles
      if (isBest(M.Vertices[A], pAB, pBC, M.Vertices[C]))
      {
        mesh_up.Faces.AddFace(npt, npt + 1, npt + 2);
        mesh_up.Faces.AddFace(npt + 2, npt + 3, npt);
      }
      else
      {
        mesh_up.Faces.AddFace(npt, npt + 1, npt + 3);
        mesh_up.Faces.AddFace(npt + 1, npt + 2, npt + 3);
      }

      uv.Add(V[A]);
      uv.Add(iso);
      uv.Add(iso);
      uv.Add(V[C]);
    }
    else
    {
      npt = mesh_up.Vertices.Count;
      mesh_up.Vertices.Add(M.Vertices[B]); //npt
      mesh_up.Vertices.Add(pAB); //npt+1
      mesh_up.Vertices.Add(pBC); //npt2
      mesh_up.Faces.AddFace(npt, npt + 1, npt + 2);
      uv.Add(V[B]);
      uv.Add(iso);
      uv.Add(iso);

      npt = mesh_low.Vertices.Count;
      mesh_low.Vertices.Add(M.Vertices[A]); //npt
      mesh_low.Vertices.Add(pAB); //npt+1
      mesh_low.Vertices.Add(pBC); //npt+2
      mesh_low.Vertices.Add(M.Vertices[C]); //npt+3
      if (isBest(M.Vertices[A], pAB, pBC, M.Vertices[C]))
      {
        mesh_low.Faces.AddFace(npt, npt + 1, npt + 2);
        mesh_low.Faces.AddFace(npt + 2, npt + 3, npt);
      }
      else
      {
        mesh_low.Faces.AddFace(npt, npt + 1, npt + 3);
        mesh_low.Faces.AddFace(npt + 1, npt + 2, npt + 3);
      }
      lv.Add(V[A]);
      lv.Add(iso);
      lv.Add(iso);
      lv.Add(V[C]);
    }
  }
  public void add_face(Mesh M, int i, List<double> V, double iso, int A, int B, int C, ref Mesh mesh_low, ref Mesh mesh_up, ref List<double> lv, ref List<double> uv)
  {
    //Value is lower of bigger than ISO

    //M is an input mesh (triangular)
    //V are values on vertex
    //Iso is a value for splitting
    int npt;

    if (V[B] <= iso)
    {
      npt = mesh_low.Vertices.Count;
      mesh_low.Vertices.Add(M.Vertices[A]); //npt
      mesh_low.Vertices.Add(M.Vertices[B]); //npt+1
      mesh_low.Vertices.Add(M.Vertices[C]); //npt+2
      mesh_low.Faces.AddFace(npt, npt + 1, npt + 2);
      lv.Add(V[A]);
      lv.Add(V[B]);
      lv.Add(V[C]);
    }
    else
    {
      npt = mesh_up.Vertices.Count;
      mesh_up.Vertices.Add(M.Vertices[A]); //npt
      mesh_up.Vertices.Add(M.Vertices[B]); //npt+1
      mesh_up.Vertices.Add(M.Vertices[C]); //npt+2
      mesh_up.Faces.AddFace(npt, npt + 1, npt + 2);
      uv.Add(V[A]);
      uv.Add(V[B]);
      uv.Add(V[C]);
    }
  }
  //For a quandrangle done with 4 points the script look at the best solution. So ration of surface between the 2 traingles must be the bigger
  public bool isBest(Point3f pt1, Point3f pt2, Point3f pt3, Point3f pt4)
  {
    bool test = true;
    double d1, d2;
    Vector3d v1_1 = new Vector3d();
    Vector3d v1_2 = new Vector3d();
    Vector3d v2_1 = new Vector3d();
    Vector3d v2_2 = new Vector3d();

    v1_1 = pt2 - pt1;
    v1_2 = pt3 - pt1;
    v2_1 = pt3 - pt1;
    v2_2 = pt4 - pt1;
    d1 = Math.Min(Vector3d.CrossProduct(v1_1, v1_2).Length, Vector3d.CrossProduct(v2_1, v2_2).Length) / Math.Max(Vector3d.CrossProduct(v1_1, v1_2).Length, Vector3d.CrossProduct(v2_1, v2_2).Length);

    v1_1 = pt2 - pt1;
    v1_2 = pt4 - pt1;
    v2_1 = pt2 - pt3;
    v2_2 = pt4 - pt3;
    d2 = Math.Min(Vector3d.CrossProduct(v1_1, v1_2).Length, Vector3d.CrossProduct(v2_1, v2_2).Length) / Math.Max(Vector3d.CrossProduct(v1_1, v1_2).Length, Vector3d.CrossProduct(v2_1, v2_2).Length);
    if (d1 > d2) test = true;
    else test = false;
    return test;
  }

  public bool isInside(double val, double A, double B)
  {
    bool retour;
    retour = false;
    if ((val >= Math.Min(A, B)) & (val <= Math.Max(A, B))) retour = true;
    return retour;
  }
# ---------- end c_script ----------
number_slider_5 = Slider(0, range=0..1)  # disabled
colour_swatch = ColourSwatch(SwatchColor=RGB(0, 0, 0))  # disabled
boolean_toggle = BooleanToggle(True)  # disabled
mesh_colours = MeshColours(Mesh=geometry, Colours=gradient)  # disabled
mesh_4 = Mesh(c_script.up_mesh)  # disabled
custom_preview_lineweights = CustomPreviewLineweights(Geometry=c_script.frontier, Shader=colour_swatch, Thickness=number_slider_5, Absolute=boolean_toggle)  # disabled

# ---- group: Legend Display
number_slider_6 = Slider(10, range=0..10)
number_slider_7 = Slider(35, range=0..1000)
number_slider_8 = Slider(655, range=0..1000)

# ----
# deformedModelView
number_slider_9 = Slider(10, range=0..10000)
list_7 = ValueList({"tx": 0, "ty": 1, "tz": 2}, selected="ty")
python_33 = GhPythonScript(
    Code=read_file_23,
    OpenSeesOutputWrapper=analyze_2.OpenSeesOutputWrapper,
    Direction=list_7,
    Scale=number_slider_9,
    ModelExstrud=Toggle(False))  # -> Out, ModelDisp, ModelCurve, Max_min
modeldisp = ModelDisp(python_33.ModelDisp)
max_min = Max_min(python_33.Max_min)
explode_tree_8 = ExplodeTree(Data=python_33.ModelCurve)  # -> Branch0, Branch1, Branch2
list_item = ListItem(List=python_33.Max_min, Index=0, Wrap=True)  # -> Item, Item1
construct_domain = ConstructDomain(DomainStart=list_item.Item1, DomainEnd=list_item.Item)
divide_curve = DivideCurve(Curve=explode_tree_8.Branch0, Count=explode_tree_8.Branch1, Kinks=False)  # -> Points, Tangents, simplify(Parameters)
dedomain = DeconstructDomain(Domain=construct_domain)  # -> Start, End
shatter = Shatter(Curve=graft(explode_tree_8.Branch0), Parameters=divide_curve.Parameters)  # -> simplify(Segments)
ghpython_script = GhPythonScript(max=dedomain.End, min=dedomain.Start)  # -> out, color, tag, domain
# ---------- ghpython_script: Python ----------
import Rhino.Geometry as rg
import ghpythonlib.components as ghcomp
import math as mt
import ghpythonlib.treehelpers as th # per data tree
import Grasshopper
#import System as sy #DV
import sys
import rhinoscriptsyntax as rs

'''
ghFilePath = ghenv.LocalScope.ghdoc.Path
ghFileName = ghenv.LocalScope.ghdoc.Name
folderNameLength = len(ghFilePath)-len(ghFileName)-2 #have to remove '.gh'
ghFolderPath = ghFilePath[0:folderNameLength]

outputPath = ghFolderPath + 'assembleData'
wrapperFile = ghFolderPath + 'assembleData\\openSeesModel.txt'

userObjectFolder = Grasshopper.Folders.DefaultUserObjectFolder
fileName = userObjectFolder + 'Alpaca'
'''
fileName = r'C:\GitHub\Alpaca4d\PythonScript\function'
sys.path.append(fileName)

def gradientJet2(value, valueMax, valueMin):

    listcolo = [ rs.CreateColor( 0, 0, 102 ),
                rs.CreateColor( 0, 0, 255 ),
                rs.CreateColor( 0, 64, 255 ),
                rs.CreateColor( 0, 128, 255 ),
                rs.CreateColor( 0, 191, 255 ),
                rs.CreateColor( 0, 255, 255 ),
                rs.CreateColor( 0, 255, 191 ),
                rs.CreateColor( 0, 255, 128 ),
                rs.CreateColor( 0, 255, 64 ),
                rs.CreateColor( 0, 255, 0 ),
                rs.CreateColor( 64, 255, 0 ),
                rs.CreateColor( 128, 255, 0 ),
                rs.CreateColor( 191, 255, 0 ),
                rs.CreateColor( 255, 255, 0 ),
                rs.CreateColor( 255, 191, 0 ),
                rs.CreateColor( 255, 128, 0 ),
                rs.CreateColor( 255, 64, 0 ),
                rs.CreateColor( 255, 0, 0 ),
                rs.CreateColor( 230, 0, 0 ),
                rs.CreateColor( 204, 0, 0 )]

    #domain = linspace( valueMin,  valueMax, len( listcolo ) )
    n = len( listcolo )
    diff = (float(valueMax) - valueMin)/( n - 1 )
    domain = [diff * i + valueMin  for i in range(n)]
    return [ listcolo, domain ]


colorList = gradientJet2( value, max, min )
color = colorList[0]  #.reverse()
color.reverse()
tag = []
tag.append( str(round(colorList[1][0],2) ) )
for i in range(1,len(colorList[1])):
    tag.append( str(round(colorList[1][i-1],2)) + '< valor < ' + str(round(colorList[1][i],2)) )
domain = colorList[1]
tag.reverse()
# ---------- end ghpython_script ----------
curve_direction_2 = GhPythonScript(Crv=flatten(shatter), Thickness=Slider(3, range=0..10), RGB=explode_tree_8.Branch2)  # -> out; inputs Crv: list of Curve, RGB: list of Color; same code as curve_direction
lng = ListLength(List=ghpython_script.domain)
planesrf = PlaneSurface(Plane=PlaneXY(0, 0, 0), XSize=Slider(40, range=0..100), YSize=Slider(2, range=0..10))
divide = DivideDomain²(Domain=planesrf, UCount=lng, VCount=1)
subsrf = Isotrim(Surface=planesrf, Domain=divide)
mcol = MeshColours(Mesh=graft(subsrf), Colours=graft(ghpython_script.color))
mjoin = MeshJoin(Meshes=flatten(mcol))
pt_3 = ConstructPoint(XCoordinate=number_slider_8, YCoordinate=number_slider_7, ZCoordinate=0)
M = Mesh(mjoin)
render_mesh_to_screen = RenderMeshToScreen(Mesh=mjoin, Location=pt_3, ScaleFactor=number_slider_6, Depth=0.95, Fixed=True, m_scWithvp=False)

# ---- group: Legend Display
number_slider_10 = Slider(10, range=0..10)
number_slider_11 = Slider(35, range=0..1000)
number_slider_12 = Slider(655, range=0..1000)

# ----
# Modal Animate
number_slider_13 = Slider(2, range=0..10)
path_3 = FilePath("C:\GitHub\Alpaca4d\PythonScript\Post-Processing\animateModal\animateModal.py")
list_8 = ValueList({"tx": 0, "ty": 1, "tz": 2}, selected="tx")
file_3 = ReadFile(File=path_3, PerLineParse=False)
planesrf_2 = PlaneSurface(Plane=PlaneXY(0, 0, 0), XSize=Slider(40, range=0..100), YSize=Slider(2, range=0..10))
pt_4 = ConstructPoint(XCoordinate=number_slider_12, YCoordinate=number_slider_11, ZCoordinate=0)

# ---- group: MODAL ANALYSIS
ghpython_script_2 = GhPythonScript(
    Code=file_3,
    OpenSeesOutputWrapper=analyze.OpenSeesOutputWrapper,
    NumberMode=Slider(8, range=0..10),
    Speed=Slider(1, range=1..20),
    Animate=Toggle(False),
    Reset=Button(),
    Scale=number_slider_13,
    Direction=list_8,
    ModelExstrud=Toggle(True))  # -> Out, ModelDisp, ModelCurve, Max_min

# ----
list_item_2 = ListItem(List=ghpython_script_2.Max_min, Index=0, Wrap=True)  # -> Item, Item1
modeldisp_2 = ModelDisp(ghpython_script_2.ModelDisp)
max_min_2 = Max_min(ghpython_script_2.Max_min)
explode_tree_9 = ExplodeTree(Data=ghpython_script_2.ModelCurve)  # -> Branch0, Branch1, Branch2
construct_domain_2 = ConstructDomain(DomainStart=list_item_2.Item1, DomainEnd=list_item_2.Item)
divide_curve_2 = DivideCurve(Curve=explode_tree_9.Branch0, Count=explode_tree_9.Branch1, Kinks=False)  # -> Points, Tangents, simplify(Parameters)
dedomain_2 = DeconstructDomain(Domain=construct_domain_2)  # -> Start, End
shatter_2 = Shatter(Curve=graft(explode_tree_9.Branch0), Parameters=divide_curve_2.Parameters)  # -> simplify(Segments)
ghpython_script_3 = GhPythonScript(max=dedomain_2.End, min=dedomain_2.Start)  # -> out, color, tag, domain; same code as ghpython_script
curve_direction_3 = GhPythonScript(Crv=flatten(shatter_2), Thickness=Slider(3, range=0..10), RGB=explode_tree_9.Branch2)  # -> out; inputs Crv: list of Curve, RGB: list of Color; same code as curve_direction
lng_2 = ListLength(List=ghpython_script_3.domain)
divide_2 = DivideDomain²(Domain=planesrf_2, UCount=lng_2, VCount=1)
subsrf_2 = Isotrim(Surface=planesrf_2, Domain=divide_2)
mcol_2 = MeshColours(Mesh=graft(subsrf_2), Colours=graft(ghpython_script_3.color))
mjoin_2 = MeshJoin(Meshes=flatten(mcol_2))
M_2 = Mesh(mjoin_2)
render_mesh_to_screen_2 = RenderMeshToScreen(Mesh=mjoin_2, Location=pt_4, ScaleFactor=number_slider_10, Depth=0.95, Fixed=True, m_scWithvp=False)
